# Grasshopper definition 1.0 JengaTower.gh (Grasshopper 1.0.7)
# plug-ins: Pufferfish, Human

number_slider = Slider(3, range=0..10)
even = Slider(8, range=2..20)
mesh = Mesh(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)
number_slider_2 = Slider(20, range=0..100)
pt = Point(Point(10.37440758, 7.637440758, 0))
previewmat = CustomPreviewMaterials(Geometry=mesh, DiffuseColor=ColourSwatch(SwatchColor=RGB(0, 0, 0)))
multiplication = Multiplication(A=number_slider, B=2)
polygon = Polygon(Plane=pt, Radius=Slider(18, range=0..100), Segments=even, FilletRadius=0)  # -> Polygon, Length
series = Series(Start=0, Step=multiplication, Count=number_slider_2)
division = Division(A=polygon.Length, B=even)
Z = UnitZ(Factor=series)
panel = Panel(division)
move = Move(Geometry=polygon.Polygon, Motion=Z)  # -> Geometry, Transform
area = Area(Geometry=move.Geometry)  # -> Area, Centroid
series_2 = Series(Start=0, Step=Slider(7.1, range=0..20), Count=number_slider_2)
rotate = Rotate(Geometry=move.Geometry, Angle=degrees(series_2), Plane=area.Centroid)  # -> Geometry, Transform
explode = Explode(Curve=rotate.Geometry, Recursive=True)  # -> simplify(Segments), Vertices
neg = Negative(Value=Slider(7, range=0..10))
tstat = TreeStatistics(Tree=explode.Segments)  # -> Paths, Length, Count
offcrv = OffsetCurve(Curve=explode.Segments, Plane=PlaneXY(0, 0, 0), Distance=neg, BothSides=False, Kinks=0, CapType=1)  # -> simplify(Offset)
item = ListItem(List=tstat.Length, Index=0, Wrap=True)
Z_2 = UnitZ(Factor=number_slider)
series_3 = Series(Start=0, Step=1, Count=item)
pshift = ShiftPaths(Data=offcrv, Offset=-1)
dispatch = Dispatch(List=series_3, DispatchPattern=[True, False])  # -> ListA, ListB
item_2 = ListItem(List=pshift, Index=dispatch.ListB, Wrap=True)
item_3 = ListItem(List=pshift, Index=dispatch.ListA, Wrap=True)
move_2 = Move(Geometry=item_2, Motion=Z_2)  # -> Geometry, Transform
merge = Merge(Data1=item_3, Data2=move_2.Geometry)
boundary = BoundarySurfaces(Edges=merge)
extr = Extrude(Base=boundary, Direction=Z_2)
graft = GraftTree(Tree=boundary, IncludeEmptyLists=True, IncludeNullItems=True)
graft_2 = GraftTree(Tree=extr, IncludeEmptyLists=True, IncludeNullItems=True)
evalsrf = EvaluateSurface(Surface=reparameterize(graft), Point=Point(0.5, 0.5, 0))  # -> Point, Normal, UDirection, VDirection, Frame
area_2 = Area(Geometry=extr)  # -> Area, graft(Centroid)
pl_origin = PlaneOrigin(Base=evalsrf.Frame, Origin=area_2.Centroid)
scale_nu = ScaleNU(
    Geometry=graft_2,
    Plane=pl_origin,
    ScaleX=Slider(1.1, range=0..10),
    ScaleY=Slider(1, range=0..5),
    ScaleZ=Slider(1.1, range=0..10))  # -> Geometry, Transform
edges = BrepEdges(Brep=scale_nu.Geometry)  # -> Naked, Interior, NonManifold
preview = CustomPreview(
    Geometry=scale_nu.Geometry,
    Material={diffuse=RGB(221, 160, 221), emission=RGB(66, 48, 66), shine=0.5, specular=RGB(255, 255, 255), transparency=0})
