# Grasshopper definition 2.0 InflatedSphere.gh (Grasshopper 1.0.7)
# plug-ins: Kangaroo2 Components, Human

number_slider = Slider(11, range=0..20)
pt = Point(Point(0, 0, 0))
rectangle = Rectangle(Plane=pt, XSize=number_slider, YSize=number_slider, Radius=0)  # -> Rectangle, Length
boxrec = BoxRectangle(Rectangle=rectangle.Rectangle, Height=number_slider)
edges = BrepEdges(Brep=boxrec)  # -> Naked, Interior, NonManifold
volume = Volume(Geometry=boxrec)  # -> Volume, Centroid
mp = MultiPipe(
    Curves=edges.Interior,
    NodeSize=Slider(0.5, range=0..1),
    EndOffset=1,
    StrutSize=1,
    Segment=0,
    KinkAngle=0.6,
    CubeFit=1,
    Caps=0)
msphere = MeshSphere(Base=volume.Centroid, Radius=Slider(3.64, range=0..10), UCount=10, VCount=20)
meshsubd = MeshFromSubD(SubD=mp, Density=2)
triremesh = TriRemesh(Geometry=meshsubd, Length=Slider(0.15, range=0..1), Iterations=25)  # -> Triangulation, Dual, Creases
triremesh_2 = TriRemesh(Geometry=msphere, Length=Slider(0.22, range=0..1), Iterations=25)  # -> Triangulation, Dual, Creases
clean = CombineClean(Meshes=triremesh_2.Triangulation)
previewmat = CustomPreviewMaterials(Geometry=triremesh.Triangulation, DiffuseColor=RGB(255, 255, 255))
demesh = DeconstructMesh(Mesh=clean)  # -> Vertices, Faces, Colours, Normals
_2º = PowerOf2(Value=Slider(500, range=0..10000))
edgelengths = EdgeLengths(Mesh=clean, LengthFactor=1, Strength=Slider(1, range=0..10))
spc = SolidPointCollide(Points=demesh.Vertices, Solid=triremesh.Triangulation, Interior=Toggle(False), Unidirectional=True, Strength=_2º)
pressure = Pressure(M=clean, Strength=Slider(0.325, range=0..1))
show = Show(G=clean)
merge = Merge(Data1=show, Data2=edgelengths, Data3=pressure, Data6=spc)
solver = Solver(GoalObjects=merge, Reset=Button(), Threshold=1e-15, Tolerance=0.0001, On=Toggle(False))  # -> I, V, flatten(O)
item = ListItem(List=solver.O, Index=0, Wrap=True)
preview = CustomPreview(
    Geometry=item,
    Material={diffuse=RGB(221, 160, 221), emission=RGB(66, 48, 66), shine=0.5, specular=RGB(255, 255, 255), transparency=0})
