# Grasshopper definition 3.0 Press-Fit Quad Rhino7.gh (Grasshopper 1.0.7)
# plug-ins: Weaverbird, Kangaroo2 Components

mesh = Mesh(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)
wbcatmullclark = WeaverbirdsCatmullClarkSubdivision(MeshCurves=mesh, Level=Slider(2, range=0..3), SmoothNakedEdges=2)
planarize = Planarize(M=wbcatmullclark, Strength=10)
show = Show(G=wbcatmullclark)
entwine = Entwine(Branch00=show, Branch01=planarize, FlattenInputs=True)
solver = Solver(GoalObjects=entwine, Reset=Button(), Threshold=1e-15, Tolerance=0.01, On=Toggle(False))  # -> I, V, O
bang = ExplodeTree(Data=solver.O)  # -> Branch0, Branch1
mesh_2 = Mesh(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)
faceb = FaceBoundaries(Mesh=mesh_2)
mesh_3 = Mesh(mesh_2)
boundary = BoundarySurfaces(Edges=faceb)
medges = MeshEdges(Mesh=mesh_3)  # -> NakedEdges, InteriorEdges, NonManifoldEdges
evalsrf = EvaluateSurface(Surface=reparameterize(boundary), Point=Point(0.5, 0.5, 0))  # -> Point, Normal, UDirection, VDirection, Frame
join = JoinCurves(Curves=medges.NakedEdges, Preserve=False)
neg = Negative(Value=Slider(0.01, range=0..0.1))
offset = OffsetCurve(Curve=faceb, Distance=neg, Plane=evalsrf.Frame, Corners=1)
warpweft = WarpWeft(Mesh=mesh_3)  # -> Warp, Weft, NakedA, NakedB
crv = Curve(warpweft.Warp)
crv_2 = Curve(warpweft.Weft)
item = ListItem(List=crv_2, Index=0, Wrap=True)
eval = EvaluateCurve(Curve=reparameterize(crv), Parameter=0.5)  # -> Point, Tangent, Angle
eval_2 = EvaluateCurve(Curve=reparameterize(crv_2), Parameter=0.5)  # -> Point, Tangent, Angle
multiplication = Multiplication(A=evalsrf.Normal, B=Slider(0.012, range=0..0.1))
flip = FlipCurve(Curve=crv_2, Guide=item)  # -> Curve, Flag
meshcp = MeshClosestPoint(Point=eval_2.Point, Mesh=mesh_3)  # -> Point, Index, Parameter
item_2 = ListItem(List=crv, Index=0, Wrap=True)
meshcp_2 = MeshClosestPoint(Point=eval.Point, Mesh=mesh_3)  # -> Point, Index, Parameter
meval = MeshEval(Mesh=mesh_3, Parameter=meshcp.Parameter)  # -> Point, Normal, Colour
flip_2 = FlipCurve(Curve=crv, Guide=item_2)  # -> Curve, Flag
eval_3 = EvaluateCurve(Curve=reparameterize(flip.Curve), Parameter=0.5)  # -> Point, Tangent, Angle
meval_2 = MeshEval(Mesh=mesh_3, Parameter=meshcp_2.Parameter)  # -> Point, Normal, Colour
eval_4 = EvaluateCurve(Curve=reparameterize(flip_2.Curve), Parameter=0.5)  # -> Point, Tangent, Angle
line = LineSDL(Start=meval_2.Point, Direction=meval_2.Normal, Length=1)
line_2 = LineSDL(Start=meval.Point, Direction=meval.Normal, Length=1)
lnln = LineLine(LineA=flip.Curve, LineB=line_2)
pl_origin = PlaneOrigin(Base=lnln, Origin=eval_3.Point)
lnln_2 = LineLine(LineA=flip_2.Curve, LineB=line)
deplane = DeconstructPlane(Plane=pl_origin)  # -> Origin, XAxis, YAxis, ZAxis
pl_origin_2 = PlaneOrigin(Base=lnln_2, Origin=eval_4.Point)
deplane_2 = DeconstructPlane(Plane=pl_origin_2)  # -> Origin, XAxis, YAxis, ZAxis
crv_cp = CurveClosestPoint(Point=deplane.Origin, Curve=join)  # -> Point, Parameter, Distance
larger = LargerThan(FirstNumber=crv_cp.Distance, SecondNumber=Slider(0.01, range=0..1))  # -> LargerThan, OrEqualTo
crv_cp_2 = CurveClosestPoint(Point=deplane_2.Origin, Curve=join)  # -> Point, Parameter, Distance
larger_2 = LargerThan(FirstNumber=crv_cp_2.Distance, SecondNumber=Slider(0.01, range=0..1))  # -> LargerThan, OrEqualTo
cull = CullPattern(List=deplane.XAxis, CullPattern=larger.LargerThan)
cull_2 = CullPattern(List=deplane.Origin, CullPattern=larger.LargerThan)
boundary_2 = BoundarySurfaces(Edges=offset)
number_slider = Slider(0.15, range=0..1)
cull_3 = CullPattern(List=deplane_2.XAxis, CullPattern=larger_2.LargerThan)
cull_4 = CullPattern(List=deplane_2.Origin, CullPattern=larger_2.LargerThan)
extr = Extrude(Base=boundary_2, Direction=graft(multiplication))
circle = CircleCNR(Center=cull_2, Normal=cull, Radius=number_slider)
number_slider_2 = Slider(0.01, range=0..0.01)
boundary_3 = BoundarySurfaces(Edges=circle)
circle_2 = CircleCNR(Center=cull_4, Normal=cull_3, Radius=number_slider)
boundary_4 = BoundarySurfaces(Edges=circle_2)
multiplication_2 = Multiplication(A=cull, B=number_slider_2)
multiplication_3 = Multiplication(A=cull_3, B=number_slider_2)
extr_2 = Extrude(Base=boundary_4, Direction=multiplication_3)
extr_3 = Extrude(Base=boundary_3, Direction=multiplication_2)
merge = Merge(Data1=extr_2, Data2=extr_3)
trim = TrimSolid(Shape=graft(merge), Cutters=flatten(extr))
edges = BrepEdges(Brep=[trim, extr])  # -> Naked, Interior, NonManifold
preview = CustomPreview(
    Geometry=trim,
    Material={diffuse=RGB(221, 160, 221), emission=RGB(66, 48, 66), shine=0.5, specular=RGB(255, 255, 255), transparency=0})
preview_2 = CustomPreview(
    Geometry=extr,
    Material={diffuse=RGB(221, 160, 221), emission=RGB(66, 48, 66), shine=0.5, specular=RGB(255, 255, 255), transparency=0})
